# Dynamo graph IfcLoad-PSetRemoval-Save.dyn (Dynamo 2.6.0.8481)
# packages: TRexIfc 0.1.0.0

file_path = Filename("Ifc4\IfcSampleHouse.ifc")
file_path_2 = Filename("Out\IfcLoad-PSetRemoval-Save.log")
file_logger = FileLog(fileName=file_path_2, LogEventLevel=1)
ifc_load = IfcLoadStoreNodeModel(fileName=file_path, logger=file_logger, IsCancelable=true)  # unwired: prefs
logMessages = Store.IfcModel.LogMessages(ifcModel=ifc_load)
propertySetNames = Store.IfcModel.PropertySetNames(ifcModel=ifc_load)
exclude_items_from = ExcludingItemListNodeModel(items=propertySetNames, SelectedValue=["Identity Data"])
ifc_authormetadata = IfcAuthorMetadataNodeModel(OrganisationId="Self employed", OrganisationName="The unknown", AuthorName="Nobody", AuthorGivenName="Mr", OrganisationAddress="Somewhere")
code_block = CodeBlock { "Changed"; }
log_reason = LogReasonComposingNodeModel(Selected=[16, 32, 64])
ifc_pset_removal = IfcPSetRemovalTransformNodeModel(removePSetNames=exclude_items_from, authorMetadata=ifc_authormetadata, canonicalName=code_block, ifcModel=ifc_load, logReasonFilter=log_reason, IsCancelable=true)
log_message_table = LogMessageTableNodeModel(source=ifc_pset_removal)
directory_path = Directory("C:\Workspace\Git\BitubTRexDynamo\Examples\Out")
relocatePath = Store.IfcModel.RelocatePath(ifcModel=ifc_pset_removal, newPathName=directory_path)
ifc_save = IfcSaveStoreNodeModel(ifcModel=relocatePath, SelectedOption="ifc", IsCancelable=true)  # unwired: separator
log_message_table_2 = LogMessageTableNodeModel(source=ifc_save)
